# Grasshopper definition appt_test.gh (Grasshopper 1.0.7)
# Copyright: prslvtsv

size_in_y_dir = Slider(3, range=0..10)
pt = Point([<point referenced from the Rhino model> x27])
crv = Curve([<curve referenced from the Rhino model> x39])
conda_location = Panel("C:\ProgramData\Anaconda3\")
to_polyominos = ToPolyominos(pt_existing=pt, size_in_y_dir=size_in_y_dir, grid_cells=crv)  # -> ij_existing, ij_remove, size_i, size_j
python = GhPythonScript(conda=conda_location)  # -> out, a
# ---------- python: Python ----------
# -*- coding: utf-8 -*-
"""
@author: prslvtsv
"""
###############################################################
#import ghdev.devcon as dev
#reload(dev)
#
#dev.init_dev_tools(locals(),  config=dev_options, verbose=True)
###############################################################

from subprocess import call, check_output
conda_activate = conda + "Scripts\\" + "Activate"

command = ";".join([])

for l in check_output(conda_activate, shell=True).splitlines():
    print l
#try:
#    print subprocess.call(["ls", "l"])
#except:
#    print "failed"
#    pass
# ---------- end python ----------
existing = Panel(to_polyominos.ij_existing)
to_remove = Panel(to_polyominos.ij_remove)
panel = Panel(python.out)

# ==== cluster ToPolyominos
grid_cells = ClusterInput()  # grid_cells
size_in_y_dir = ClusterInput()  # size in Y dir
pt_existing = ClusterInput()  # pt_existing
data = Data(grid_cells)
pcen = PolygonCenter(Polyline=data)  # -> CenterV, CenterE, CenterA
sort_pt = SortPoints(Points=pcen.CenterV)  # -> Points, Indices
data_2 = Data(size_in_y_dir)
data_3 = Data(pt_existing)
partition = PartitionList(List=sort_pt.Points, Size=data_2)
cir = Circle(Plane=data_3, Radius=1)
sort_pt_2 = SortPoints(Points=partition)  # -> Points, Indices
pdecon = Deconstruct(Point=sort_pt_2.Points)  # -> XComponent, YComponent, ZComponent
panel = Panel(sort_pt_2.Points)
sort = SortList(Keys=pdecon.YComponent, ValuesA=sort_pt_2.Points)  # -> Keys, ValuesA
flip = FlipMatrix(Data=sort.ValuesA)
ptcomposenum = ComposeGridNumber(Points=flatten(flip), RowNum=data_2)
incurve = PointInCurve(Point=graft(ptcomposenum), Curve=cir)  # -> Relationship, Point
ma = MassAddition(Input=incurve.Relationship)  # -> Result, PartialResults
viewer = ParamViewer(ptcomposenum)
trim = TrimTree(Tree=ma.Result, Depth=1)
bool = Boolean(ma.Result)
bool_2 = Boolean(trim)
not = GateNot(A=bool_2)
ptindices = ExtractGridIndices(Grid=ptcomposenum)  # -> I_Indices, J_Indices
branch = TreeBranch(Tree=ptcomposenum, Path=Slider(0, range=0..10), MaintainPaths=True)
cull = CullPattern(List=ptindices.I_Indices, CullPattern=bool_2)
cull_2 = CullPattern(List=ptindices.J_Indices, CullPattern=bool_2)
cull_3 = CullPattern(List=ptindices.J_Indices, CullPattern=not)
cull_4 = CullPattern(List=ptindices.I_Indices, CullPattern=not)
python = GhPythonScript(x=cull_2, y=cull)  # -> out, a
# ---------- python: Python ----------
# -*- coding: utf-8 -*-
"""
@author: prslvtsv
"""
a = "({}, {})".format(x, y)
# ---------- end python ----------
lng = ListLength(List=ptcomposenum)  # -> flatten(Length)
clean = CleanTree(RemoveNulls=True, RemoveInvalid=True, RemoveEmpty=True, Tree=cull_4)
clean_2 = CleanTree(RemoveNulls=True, RemoveInvalid=True, RemoveEmpty=True, Tree=cull_3)
python_2 = GhPythonScript(x=flatten(python.a))  # -> out, a; inputs x: list
# ---------- python_2: Python ----------
# -*- coding: utf-8 -*-
"""
@author: prslvtsv
"""
b = ", ".join(x)
a = "[" + b + "]"
# ---------- end python_2 ----------
item = ListItem(List=lng, Index=0, Wrap=True)
lng_2 = ListLength(List=lng)
python_3 = GhPythonScript(x=clean_2, y=clean)  # -> out, flatten(a); same code as python
python_4 = GhPythonScript(x=flatten(python_3.a))  # -> out, a; inputs x: list; same code as python_2
size_i = ClusterOutput(lng_2)  # ij_existing
ij_existing = ClusterOutput(python_2.a)  # ij_existing
size_j = ClusterOutput(item)  # ij_existing
ij_remove = ClusterOutput(python_4.a)  # ij_remove
